# Dynamo graph Clash Ball v3.dyn "Clash Bal v3" (Dynamo 2.5.0.7460)
# packages: Zhukoven.com 2021.2.27

# group: Input
family_types_ensure_is_bubble = FamilyTypes("bubble_Clash_Shared_Para:bubble_Clash_Shared_Para")  # "Family Types (Ensure is bubble_Clash_Shared_Para)"; graph input
file_path = Filename("..\..\02 Coding\NWDClashTemplate.xml")  # graph input

code_block = CodeBlock { 1000; }
string_from_object = FromObject(obj=file_path)
python_script_parse_xml_clash = Python(IN[0]=string_from_object)  # "Python Script_Parse XML Clash Report"
# ---------- python_script_parse_xml_clash.python (50 lines) ----------
import xml.etree.ElementTree as ET

tree = ET.parse(IN[0]) #IN[0]
exchange = tree.getroot()

clashname = []
clashdistance = []
clashx = []
clashy = []
clashz = []
gridlocation = []
obj1ID = []
obj2ID = []
info1 = []
info2 = []

batchtest = exchange.find('batchtest')
clashtests = batchtest.find('clashtests')
clashtest = clashtests.find('clashtest')
clashresults = clashtest.find('clashresults')
for clashresult in clashresults:
    clashname.append(clashresult.get('name'))
    clashdistance.append(clashresult.get('distance'))

    crchildren = clashresult.getchildren()
    clashpoint = crchildren[2].getchildren()
    clashx.append(clashpoint[0].get('x'))
    clashy.append(clashpoint[0].get('y'))
    clashz.append(clashpoint[0].get('z'))

    gridlocation.append(crchildren[3].text)

    clashobjects = crchildren[5]

    clashobject = clashobjects.getchildren()

    objectattribute0 = clashobject[0].getchildren()
    objattr = objectattribute0[0].getchildren()
    obj1ID.append(objattr[1].text)
    pathlink1 = objectattribute0[2].getchildren()
    info1.append(pathlink1[4].text+" : "+pathlink1[5].text)


    objectattribute1 = clashobject[1].getchildren()
    objattr = objectattribute1[0].getchildren()
    obj2ID.append(objattr[1].text)
    pathlink2 = objectattribute1[2].getchildren()
    info2.append(pathlink2[4].text+" : "+pathlink2[5].text)
#Preparing output to Dynamo
OUT = [clashname, clashdistance, clashx, clashy, clashz, gridlocation, obj1ID, obj2ID, info1, info2]
# ----------------------------------------
# note: 0: clashname
# 1: clashdistance
# 2: clashx
# 3: clashy
# 4: clashz
# 5: gridlocation
# 6: obj1ID
# 7: obj2ID
# 8: info1
# 9: info2
code_block_2 = CodeBlock(a=python_script_parse_xml_clash) { a[0]; a[1]; a[2]; a[3]; a[4]; a[6]; a[7]; a[8]; a[9]; }

# group: Create coordinates of Clashes
toNumber = String.ToNumber(str=code_block_2.out2)
mul = code_block * toNumber
toNumber_2 = String.ToNumber(str=code_block_2.out3)
mul_2 = code_block * toNumber_2
toNumber_3 = String.ToNumber(str=code_block_2.out4)
mul_3 = code_block * toNumber_3
byCoordinates = Point.ByCoordinates(x=mul, y=mul_2, z=mul_3)

byPointEachRun = Custom[FamilyInstance.ByPointEachRun](familyType=family_types_ensure_is_bubble, points=byCoordinates)  # package Zhukoven.com; Place family instance by point each time you hit the 'Run' button without deleting previously placed ones. Don't use this node in 'Auto' mode!
code_block_3 = CodeBlock()
# ---------- code_block_3.designscript (10 lines) ----------
"Clash_Discipline";
"Clash_Name";
"Clash_Item_1";
"Clash_Element_ID_1";
"Clash_Item_2";
"Clash_Element_ID_2";
"Clash_Distance";
"Clash_Solved";
"Clash_Grid_Location";
"Clash_Remark";
# ----------------------------------------
setParameterByName = Element.SetParameterByName(element=byPointEachRun, parameterName=code_block_3.out2, value=code_block_2.out7)
setParameterByName_2 = Element.SetParameterByName(element=byPointEachRun, parameterName=code_block_3.out5, value=code_block_2.out6)
setParameterByName_3 = Element.SetParameterByName(element=byPointEachRun, parameterName=code_block_3.out3, value=code_block_2.out5)
boolean = BoolSelector(false)
setParameterByName_4 = Element.SetParameterByName(element=byPointEachRun, parameterName=code_block_3.out7, value=boolean, lacing=Longest)
setParameterByName_5 = Element.SetParameterByName(element=byPointEachRun, parameterName=code_block_3.out4, value=code_block_2.out8)
toNumber_4 = String.ToNumber(str=code_block_2.out1)
setParameterByName_6 = Element.SetParameterByName(element=byPointEachRun, parameterName=code_block_3.out6, value=toNumber_4)
code_block_4 = CodeBlock(a=python_script_parse_xml_clash) { a[5]; }
code_block_5 = CodeBlock { " : "; }
split = String.Split(str=code_block_4, separator0=code_block_5)
code_block_6 = CodeBlock { 0; 1; }
list_getitematindex__grid = List.GetItemAtIndex(list=split@L2, index=code_block_6.out0)
setParameterByName_7 = Element.SetParameterByName(element=byPointEachRun, parameterName=code_block_3.out8, value=list_getitematindex__grid)
getItemAtIndex_Level = List.GetItemAtIndex(list=split@L2, index=code_block_6.out1)  # "List.GetItemAtIndex_Level"
setParameterByName_8 = Element.SetParameterByName(element=byPointEachRun, parameterName=code_block_3.out9, value=getItemAtIndex_Level)
setParameterByName_9 = Element.SetParameterByName(element=byPointEachRun, parameterName=code_block_3.out1, value=code_block_2.out0)
number_of_clashes = List.Count(list=byPointEachRun)  # graph output
