# Dynamo graph Clash Ball v1.dyn "Clash Ball" (Dynamo 2.0.4.12684)

family_types = FamilyTypes(index=48)
file_path = Filename("..\..\Desktop\20220128.xlsx")
file_from_path = FileObject(path=file_path)
code_block = CodeBlock { "Sheet1"; }
importExcel = Data.ImportExcel(file=file_from_path, sheetName=code_block)
watch = Watch(importExcel)
transpose = List.Transpose(lists=watch)

# group: Coordinate
code_block_2 = CodeBlock(a=transpose) { a[6]; }
code_block_3 = CodeBlock { 0; }
removeItemAtIndex = List.RemoveItemAtIndex(list=code_block_2, indices=code_block_3)
code_block_4 = CodeBlock { 1000; }
mul = removeItemAtIndex * code_block_4
code_block_5 = CodeBlock(a=transpose) { a[7]; }
removeItemAtIndex_2 = List.RemoveItemAtIndex(list=code_block_5, indices=code_block_3)
mul_2 = removeItemAtIndex_2 * code_block_4
code_block_6 = CodeBlock(a=transpose) { a[8]; }
removeItemAtIndex_3 = List.RemoveItemAtIndex(list=code_block_6, indices=code_block_3)
mul_3 = removeItemAtIndex_3 * code_block_4
byCoordinates = Point.ByCoordinates(x=mul, y=mul_2, z=mul_3)

byPoint = FamilyInstance.ByPoint(familyType=family_types, point=byCoordinates)
watch_2 = Watch(byPoint)
code_block_7 = CodeBlock()
# ---------- code_block_7.designscript (9 lines) ----------
"Clash_Discipline";
"Clash_Name";
"Clash_Item_1";
"Clash_Element_ID_1";
"Clash_Item_2";
"Clash_Element_ID_2";
"Clash_Distance";
"Clash_Solved";
"Clash_Grid_Location";
# ----------------------------------------
code_block_clash_name = CodeBlock(a=transpose) { a[0]; }
removeItemAtIndex_4 = List.RemoveItemAtIndex(list=code_block_clash_name, indices=code_block_3)
setParameterByName = Element.SetParameterByName(element=watch_2, parameterName=code_block_7.out1, value=removeItemAtIndex_4)
code_block_name_1 = CodeBlock(a=transpose) { a[12]; }
removeItemAtIndex_5 = List.RemoveItemAtIndex(list=code_block_name_1, indices=code_block_3)
setParameterByName_2 = Element.SetParameterByName(element=watch_2, parameterName=code_block_7.out2, value=removeItemAtIndex_5)
code_block_8 = CodeBlock { " WIP"; }
split = String.Split(str=code_block, separater0=code_block_8)
code_block_9 = CodeBlock { "20220128 All trade"; }
count = List.Count(list=removeItemAtIndex)
passthrough = Custom[Passthrough](passThrough=code_block_9, waitFor=count)  # Forces a sequential order of execution. The node wired into the output of the Passthrough node will be executed *after* the node wired into the waitFor input (e.g. important for some Revit operations). The value of the passThrough input will be passed on to the node wired into the output port of the Passthrough node.
python_script = Python(IN[0]=passthrough, IN[1]=count)
# ---------- python_script.python (14 lines) ----------
# Enable Python support and load DesignScript library
import clr
clr.AddReference('ProtoGeometry')
from Autodesk.DesignScript.Geometry import *

# The inputs to this node will be stored as a list in the IN variables.
dataEnteringNode = IN

# Place your code below this line
oo=[]
for i in range(IN[1]):
	oo.append(IN[0]);
# Assign your output to the OUT variable.
OUT = oo
# ----------------------------------------
setParameterByName_3 = Element.SetParameterByName(element=watch_2, parameterName=code_block_7.out0, value=python_script)
code_block_id_1 = CodeBlock(a=transpose) { a[9]; }
removeItemAtIndex_6 = List.RemoveItemAtIndex(list=code_block_id_1, indices=code_block_3)
string_from_object = FromObject(obj=removeItemAtIndex_6)
code_block_10 = CodeBlock { "."; }
split_2 = String.Split(str=string_from_object, separater0=code_block_10)
transpose_2 = List.Transpose(lists=split_2)
code_block_11 = CodeBlock(a=transpose_2) { a[0]; }
setParameterByName_4 = Element.SetParameterByName(element=watch_2, parameterName=code_block_7.out3, value=code_block_11)
code_block_name_2 = CodeBlock(a=transpose) { a[17]; }
removeItemAtIndex_7 = List.RemoveItemAtIndex(list=code_block_name_2, indices=code_block_3)
setParameterByName_5 = Element.SetParameterByName(element=watch_2, parameterName=code_block_7.out4, value=removeItemAtIndex_7)
code_block_id_2 = CodeBlock(a=transpose) { a[14]; }
removeItemAtIndex_8 = List.RemoveItemAtIndex(list=code_block_id_2, indices=code_block_3)
string_from_object_2 = FromObject(obj=removeItemAtIndex_8)
split_3 = String.Split(str=string_from_object_2, separater0=code_block_10)
transpose_3 = List.Transpose(lists=split_3)
code_block_12 = CodeBlock(a=transpose_3) { a[0]; }
setParameterByName_6 = Element.SetParameterByName(element=watch_2, parameterName=code_block_7.out5, value=code_block_12)
code_block_id_2_2 = CodeBlock(a=transpose) { a[2]; }
removeItemAtIndex_9 = List.RemoveItemAtIndex(list=code_block_id_2_2, indices=code_block_3)
setParameterByName_7 = Element.SetParameterByName(element=watch_2, parameterName=code_block_7.out6, value=removeItemAtIndex_9)
code_block_13 = CodeBlock { false; }
setParameterByName_8 = Element.SetParameterByName(element=watch_2, parameterName=code_block_7.out7, value=code_block_13)
family_instance_by_point_in = Custom[Family Instance By Point in Transaction](familyType=family_types)  # frozen; unwired: points
code_block_grid_location = CodeBlock(a=transpose) { a[3]; }
removeItemAtIndex_10 = List.RemoveItemAtIndex(list=code_block_grid_location, indices=code_block_3)
setParameterByName_9 = Element.SetParameterByName(element=watch_2, parameterName=code_block_7.out8, value=removeItemAtIndex_10)
