# Dynamo graph 01 Builderswork.dyn "Builderswork" (Dynamo 2.5.0.7460)
# packages: Clockwork for Dynamo 2.x 2.3.0, SteamNodes 1.2.4, Zhukoven.com 2021.2.27, bimorphNodes 4.1.2, Rhythm 2022.1.5

categories_wall_or_floor = Categories("OST_Walls")  # graph input
all_elements_of_category = ElementsOfCategory(Category=categories_wall_or_floor)
categories = Categories("OST_CableTray")
all_elements_of_category_2 = ElementsOfCategory(Category=categories)
categories_2 = Categories("OST_DuctCurves")
all_elements_of_category_3 = ElementsOfCategory(Category=categories_2)
categories_3 = Categories("OST_PipeCurves")
all_elements_of_category_4 = ElementsOfCategory(Category=categories_3)
list_create = List.Create(item0=all_elements_of_category_2, item1=all_elements_of_category_3, item2=all_elements_of_category_4)
flatten = List.Flatten(list=list_create)

# group: CBWD Location Detection
revit_element_clash_detection_v1 = Custom[Revit Element Clash Detection v1]()  # frozen; unwired: RevitElementSetA, RevitElementSetB
python_script = Python(IN[0]=all_elements_of_category, IN[1]=flatten)
# ---------- python_script.python (77 lines) ----------
import clr
clr.AddReference('ProtoGeometry')
from Autodesk.DesignScript.Geometry import *
# Import ToDSType(bool) extension method
clr.AddReference("RevitNodes")
import Revit
clr.ImportExtensions(Revit.Elements)
# Import geometry conversion extension methods
clr.ImportExtensions(Revit.GeometryConversion)
# Import DocumentManager and TransactionManager
clr.AddReference("RevitServices")
import RevitServices
from RevitServices.Persistence import DocumentManager
from RevitServices.Transactions import TransactionManager
from System.Collections.Generic import *
# Import RevitAPI
clr.AddReference("RevitAPI")
import Autodesk
from Autodesk.Revit.DB import *

doc = DocumentManager.Instance.CurrentDBDocument
uiapp = DocumentManager.Instance.CurrentUIApplication
app = uiapp.Application
uidoc=DocumentManager.Instance.CurrentUIApplication.ActiveUIDocument

#The inputs to this node will be stored as a list in the IN variable.
#dataEnteringNode = IN

clashElementsAdirty=IN[0]
clashElementsBdirty=IN[1]

# Place your code below this line

clashElementsA = []
clashElementsB = []
clashGeomA = []
FailuresA = []
clashGeomB = []
FailuresB = []
clashFoundA = []
clashFoundB = []
clashSolids = []
clashPoints = []

for a in clashElementsAdirty:
	try:
		clashGeomA.append(a.Geometry()[0])
		clashElementsA.append(a)
	except:
		FailuresA.append(a)
for b in clashElementsBdirty:
	try:
		clashGeomB.append(b.Geometry()[0])
		clashElementsB.append(b)
	except:
		FailuresB.append(b)

counterA = range(len(clashElementsA))
counterB = range(len(clashElementsB))

for i in counterA:
	tempGeomA = clashGeomA[i]
	for j in counterB:
#		tempGeomB = clashGeomB[j]
#		clashIntersectResults.append(tempGeomB.DoesIntersect(tempGeomA))
#		if tempGeomA.DoesIntersect(tempGeomB):
		if clashGeomA[i].DoesIntersect(clashGeomB[j]) == True:
#		clashIntersectResults.append(clashGeomA[i].DoesIntersect(clashGeomB[j]))
			clashFoundA.append(clashElementsA[i])
			clashFoundB.append(clashElementsB[j])
			tempSolid = clashGeomA[i].Intersect(clashGeomB[j])
			clashSolids.append(tempSolid[0])
			clashPoints.append(tempSolid[0].Centroid())


# Assign your output to the OUT variable.
OUT = clashFoundA, clashFoundB, clashSolids, clashPoints, FailuresA, FailuresB
# ----------------------------------------
code_block_clash_geometry = CodeBlock(OUT1=python_script) { OUT1[3]; }  # "Code Block_Clash Geometry Centroid"
code_block_clash_element_a_wall = CodeBlock(OUT1=python_script) { OUT1[0]; }
code_block_clash_element_b_mep = CodeBlock(OUT1=python_script) { OUT1[1]; }
code_block_clash_geometry_2 = CodeBlock(OUT1=python_script) { OUT1[2]; }

# group: Opening Family Instance Placing
family_types_pme_bwic_rect_or = FamilyTypes("PME_BWIC:Rectangular")  # "Family Types (PME BWIC rect or cir)"; graph input
byPointEachRun = Custom[FamilyInstance.ByPointEachRun](familyType=family_types_pme_bwic_rect_or, points=code_block_clash_geometry)  # package Zhukoven.com; Place family instance by point each time you hit the 'Run' button without deleting previously placed ones. Don't use this node in 'Auto' mode!

watch = Watch(byPointEachRun)
code_block = CodeBlock()
# ---------- code_block.designscript (7 lines) ----------
"PME_BWIC Thickness";
"PME_BWIC Height";
"PME_BWIC Width";
"PME_BWIC Wall/Floor ID";
"PME_BWIC Element Name";
"PME_BWIC Element ID";
"PME_BWIC Rotated Degree";
# ----------------------------------------

# group: Wall (in link) Thickness --> Opening Depth
getTotalWidth = Custom[Wall.GetTotalWidth](Walls=code_block_clash_element_a_wall)  # package SteamNodes; Get Wall's Total Width parameter
code_block_2 = CodeBlock { 1000; }
mul = getTotalWidth * code_block_2
passthrough = Custom[Passthrough](passThrough=mul, waitFor=watch)  # package Clockwork for Dynamo 2.x; Forces a sequential order of execution. The node wired into the output of the Passthrough node will be executed *after* the node wired into the waitFor input (e.g. important for some Revit operations). The value of the passThrough input will be passed on to the node wired into the output port of the Passthrough node.

setParameterByName = Element.SetParameterByName(element=watch, parameterName=code_block.out0, value=passthrough)
code_block_3 = CodeBlock { "Width"; }
getParameterValueByName = Element.GetParameterValueByName(element=code_block_clash_element_b_mep, parameterName=code_block_3)
code_block_4 = CodeBlock(a=getParameterValueByName) { a==""; }
code_block_5 = CodeBlock { "Diameter"; }
getParameterValueByName_2 = Element.GetParameterValueByName(element=code_block_clash_element_b_mep, parameterName=code_block_5)
if_ = If(test=code_block_4, true=getParameterValueByName_2, false=getParameterValueByName)
integer_slider_tolerance = IntegerSlider(100, range=0..300 step 50)  # graph input
add = if_ + integer_slider_tolerance
setParameterByName_2 = Element.SetParameterByName(element=watch, parameterName=code_block.out2, value=add)
code_block_6 = CodeBlock { "Height"; }
getParameterValueByName_3 = Element.GetParameterValueByName(element=code_block_clash_element_b_mep, parameterName=code_block_6)
code_block_7 = CodeBlock(b=getParameterValueByName_3) { b==""; }
if_2 = If(test=code_block_7, true=getParameterValueByName_2, false=getParameterValueByName_3)
add_2 = if_2 + integer_slider_tolerance
setParameterByName_3 = Element.SetParameterByName(element=watch, parameterName=code_block.out1, value=add_2)

# group: Set Rotation of Opening along Wall
ZAxis = Vector.ZAxis()
location = Custom[Element.Location+](element=code_block_clash_element_a_wall)  # package Clockwork for Dynamo 2.x; Returns the location of an element as point, curve or curve loop, along with some booleans to help filtering the results. Unlike the OOTB Element.GetLocation node, it also retunrs sketch lines of sketch-based elements like floor slabs as well as the element's rotation property.
code_block_8 = CodeBlock { 0; 1; }
getItemAtIndex = List.GetItemAtIndex(list=location.curveEndpoints@L2, index=code_block_8.out0)
getItemAtIndex_2 = List.GetItemAtIndex(list=location.curveEndpoints@L2, index=code_block_8.out1)
byTwoPoints = Vector.ByTwoPoints(start=getItemAtIndex, end=getItemAtIndex_2)
X = Point.X(point=getItemAtIndex)
code_block_9 = CodeBlock(a=X) { b=a+1000; }
Y = Point.Y(point=getItemAtIndex)
Z = Point.Z(point=getItemAtIndex)
byCoordinates = Point.ByCoordinates(x=code_block_9, y=Y, z=Z)
byTwoPoints_2 = Vector.ByTwoPoints(start=getItemAtIndex, end=byCoordinates)
angleWithVector = Vector.AngleWithVector(vector=byTwoPoints, otherVector=byTwoPoints_2)
round = Math.Round(number=angleWithVector)
passthrough_2 = Custom[Passthrough](passThrough=round, waitFor=watch)
setRotation = FamilyInstance.SetRotation(familyInstance=watch, degree=passthrough_2)

# group: [Developing] Calculate opening width and height
explode = Geometry.Explode()  # frozen; unwired: geometry
code_block_10 = CodeBlock { 0.5; }
pointAtParameter = Surface.PointAtParameter(surface=explode, u=code_block_10, v=code_block_10)
normalAtPoint = Surface.NormalAtPoint(surface=explode, point=pointAtParameter)

# group: Wall/Floor ID
id = Element.Id(element=code_block_clash_element_a_wall)
string_from_object = FromObject(obj=id)

setParameterByName_4 = Element.SetParameterByName(element=watch, parameterName=code_block.out3, value=string_from_object)

# group: MEP Name and ID
id_2 = Element.Id(element=code_block_clash_element_b_mep)
string_from_object_2 = FromObject(obj=id_2)
name = Element.Name(element=code_block_clash_element_b_mep)

setParameterByName_5 = Element.SetParameterByName(element=watch, parameterName=code_block.out5, value=string_from_object_2)
setParameterByName_6 = Element.SetParameterByName(element=watch, parameterName=code_block.out4, value=name)
links_revit_link_of_wall_and = Links()  # "Links (Revit Link of Wall and Floor)"; nothing selected; graph input; frozen
ofCategory = Revit.LinkElement.OfCategory(linkInstance=links_revit_link_of_wall_and, category=categories_wall_or_floor)
element = Revit.LinkElement.Element(linkElement=ofCategory)
setParameterByName_7 = Element.SetParameterByName(element=watch, parameterName=code_block.out6, value=round)
