# Dynamo graph 02 Merge.dyn "Merge" (Dynamo 2.5.0.7460)
# packages: Clockwork for Dynamo 2.x 2.3.0, Zhukoven.com 2021.2.27, spring nodes 204.1.0

family_types = FamilyTypes("PME_BWIC:Rectangular")
select_bwic_to_merge = DSModelElementsSelection()  # 2 picked in the model; graph input
location = Custom[Element.Location+](element=select_bwic_to_merge)  # package Clockwork for Dynamo 2.x; Returns the location of an element as point, curve or curve loop, along with some booleans to help filtering the results. Unlike the OOTB Element.GetLocation node, it also retunrs sketch lines of sketch-based elements like floor slabs as well as the element's rotation property.
XY = Plane.XY()
ꟿ_point_pullontoplane = Custom[ꟿ Point.PullOntoPlane](point=location.points, plane=XY)  # package spring nodes; Pulls (projects) the point onto the input plane, following the plane normal.
byBestFitThroughPoints = Line.ByBestFitThroughPoints(bestFitPoints=ꟿ_point_pullontoplane)
code_block = CodeBlock { [0,1]; }
pointAtParameter = Curve.PointAtParameter(curve=byBestFitThroughPoints, param=code_block, lacing=Longest)
code_block_2 = CodeBlock(a=pointAtParameter) { a[0]; a[1]; }
byTwoPoints = Vector.ByTwoPoints(start=code_block_2.out0, end=code_block_2.out1)
code_block_3 = CodeBlock { "PME_BWIC Width"; }
getParameterValueByName = Element.GetParameterValueByName(element=select_bwic_to_merge, parameterName=code_block_3)
code_block_width_2 = CodeBlock(b=getParameterValueByName) { a=b/2; }
translate = Geometry.Translate(geometry=ꟿ_point_pullontoplane, direction=byTwoPoints, distance=code_block_width_2, lacing=Longest)
byTwoPoints_2 = Vector.ByTwoPoints(start=code_block_2.out1, end=code_block_2.out0)
translate_2 = Geometry.Translate(geometry=ꟿ_point_pullontoplane, direction=byTwoPoints_2, distance=code_block_width_2, lacing=Longest)
join = List.Join(list0=translate, list1=translate_2)
byBestFitThroughPoints_2 = Line.ByBestFitThroughPoints(bestFitPoints=join)
code_block_4 = CodeBlock { [0,1]; }
pointAtParameter_2 = Curve.PointAtParameter(curve=byBestFitThroughPoints_2, param=code_block_4, lacing=Longest)
code_block_5 = CodeBlock(a=pointAtParameter_2) { a[0]; a[1]; }
byTwoPoints_3 = Vector.ByTwoPoints(start=code_block_5.out0, end=code_block_5.out1)
code_block_6 = CodeBlock { 0.5; }
scale = Vector.Scale(vector=byTwoPoints_3, scale_factor=code_block_6)
translate_3 = Geometry.Translate(geometry=code_block_5.out0, direction=scale)
code_block_7 = CodeBlock { 1; }
byCoordinates = Vector.ByCoordinates(z=code_block_7)
Z = Point.Z(point=location.points)
code_block_8 = CodeBlock { "PME_BWIC Height"; }
getParameterValueByName_2 = Element.GetParameterValueByName(element=select_bwic_to_merge, parameterName=code_block_8)
code_block_height_2 = CodeBlock(b=getParameterValueByName_2) { a=b/2; }
code_block_9 = CodeBlock(b=Z, c=code_block_height_2) { a=b+c; }
maximumItem = List.MaximumItem(list=code_block_9)
code_block_10 = CodeBlock(b=Z, c=code_block_height_2) { a=b-c; }
minimumItem = List.MinimumItem(list=code_block_10)
code_block_11 = CodeBlock(b=maximumItem, c=minimumItem) { a=(b-c)/2+c; }
translate_4 = Geometry.Translate(geometry=translate_3, direction=byCoordinates, distance=code_block_11)
byPoint = FamilyInstance.ByPoint(familyType=family_types, point=translate_4)
code_block_12 = CodeBlock { "PME_BWIC Thickness"; "PME_BWIC Width"; "PME_BWIC Height"; "PME_BWIC Element ID"; "PME_BWIC Element Name"; }
code_block_13 = CodeBlock { "PME_BWIC Thickness"; }
getParameterValueByName_3 = Element.GetParameterValueByName(element=select_bwic_to_merge, parameterName=code_block_13)
uniqueItems = List.UniqueItems(list=getParameterValueByName_3)
setParameterByName = Element.SetParameterByName(element=byPoint, parameterName=code_block_12.out0, value=uniqueItems)
code_block_new_rect_height = CodeBlock(b=maximumItem, c=minimumItem) { a=b-c; }
setParameterByName_2 = Element.SetParameterByName(element=byPoint, parameterName=code_block_12.out2, value=code_block_new_rect_height)
length = Curve.Length(curve=byBestFitThroughPoints_2)
setParameterByName_3 = Element.SetParameterByName(element=byPoint, parameterName=code_block_12.out1, value=length)
byPointEachRun = Custom[FamilyInstance.ByPointEachRun]()  # package Zhukoven.com; Place family instance by point each time you hit the 'Run' button without deleting previously placed ones. Don't use this node in 'Auto' mode!; unwired: familyType, points
code_block_14 = CodeBlock { "PME_BWIC Element ID"; }
getParameterValueByName_4 = Element.GetParameterValueByName(element=select_bwic_to_merge, parameterName=code_block_14)
code_block_15 = CodeBlock { ","; }
add = getParameterValueByName_4 + code_block_15
concat = String.Concat(string0=add)
code_block_16 = CodeBlock { -1; 1; }
remove = String.Remove(str=concat, startIndex=code_block_16.out0, count=code_block_16.out1)
setParameterByName_4 = Element.SetParameterByName(element=byPoint, parameterName=code_block_12.out3, value=remove)
code_block_17 = CodeBlock { "PME_BWIC Element Name"; }
getParameterValueByName_5 = Element.GetParameterValueByName(element=select_bwic_to_merge, parameterName=code_block_17)
code_block_18 = CodeBlock { ","; }
add_2 = getParameterValueByName_5 + code_block_18
concat_2 = String.Concat(string0=add_2)
code_block_19 = CodeBlock { -1; 1; }
remove_2 = String.Remove(str=concat_2, startIndex=code_block_19.out0, count=code_block_19.out1)
setParameterByName_5 = Element.SetParameterByName(element=byPoint, parameterName=code_block_12.out4, value=remove_2)
code_block_20 = CodeBlock { "PME_BWIC Rotated Degree"; }
getParameterValueByName_6 = Element.GetParameterValueByName(element=select_bwic_to_merge, parameterName=code_block_20)
uniqueItems_2 = List.UniqueItems(list=getParameterValueByName_6)
setRotation = FamilyInstance.SetRotation(familyInstance=byPoint, degree=uniqueItems_2)
passthrough = Custom[Passthrough](passThrough=select_bwic_to_merge, waitFor=setRotation)  # frozen; package Clockwork for Dynamo 2.x; Forces a sequential order of execution. The node wired into the output of the Passthrough node will be executed *after* the node wired into the waitFor input (e.g. important for some Revit operations). The value of the passThrough input will be passed on to the node wired into the output port of the Passthrough node.
delete = Element.Delete(element=passthrough)
setRotation_2 = FamilyInstance.SetRotation()  # unwired: familyInstance, degree
byOriginDirection = Revit.References.RayBounce.ByOriginDirection()  # unwired: origin, direction, maxBounces, view
parameters = Element.Parameters(element=setRotation)
watch = Watch(parameters)  # graph output
code_block_21 = CodeBlock { "PME_BWIC Wall/Floor ID"; }
getParameterValueByName_7 = Element.GetParameterValueByName(element=select_bwic_to_merge, parameterName=code_block_21)
uniqueItems_3 = List.UniqueItems(list=getParameterValueByName_7)
setParameterByName_6 = Element.SetParameterByName(element=byPoint, parameterName=code_block_21, value=uniqueItems_3)
