# Dynamo graph 03 Delete.dyn "Delete" (Dynamo 2.5.0.7460)
# packages: Zhukoven.com 2021.2.27

family_types = FamilyTypes("PME_BWIC:Rectangular")
all_elements_of_family_type = ElementsOfFamilyType(Family_Type=family_types)
code_block = CodeBlock { "PME_BWIC Element ID"; }
getParameterValueByName = Element.GetParameterValueByName(element=all_elements_of_family_type, parameterName=code_block)
code_block_2 = CodeBlock { ","; }
contains = String.Contains(str=getParameterValueByName, searchFor=code_block_2)
filterByBoolMask = List.FilterByBoolMask(list=all_elements_of_family_type, mask=contains)
filterByBoolMask_2 = List.FilterByBoolMask(list=getParameterValueByName, mask=contains)
split = String.Split(str=filterByBoolMask_2.in, separator0=code_block_2)
flatten = List.Flatten(list=split)
uniqueItems = List.UniqueItems(list=flatten)
containsItems = Custom[List.ContainsItems](list=filterByBoolMask_2.out, items=uniqueItems)  # package Zhukoven.com; Checks if each item of a given list matches at least one item of another list
filterByBoolMask_3 = List.FilterByBoolMask(list=filterByBoolMask.out, mask=containsItems)
delete = Element.Delete(element=filterByBoolMask_3.in)
