# Dynamo graph 04 Create Section Views.dyn (Dynamo 2.5.0.7460)
# packages: Data-Shapes 2022.2.103, Clockwork for Dynamo 2.x 2.3.0, WombatDynamo 2.3.5

family_types = FamilyTypes("PME_BWIC:Rectangular")
all_elements_of_family_type = ElementsOfFamilyType(Family_Type=family_types)
code_block = CodeBlock { "PME_BWIC Wall/Floor ID"; }
getParameterValueByName = Element.GetParameterValueByName(element=all_elements_of_family_type, parameterName=code_block)
uniqueItems = List.UniqueItems(list=getParameterValueByName)
toNumber = String.ToNumber(str=uniqueItems)
byId = WombatDynamo.Element.ById(id=toNumber)
location = Custom[Element.Location+](element=byId)  # package Clockwork for Dynamo 2.x; Returns the location of an element as point, curve or curve loop, along with some booleans to help filtering the results. Unlike the OOTB Element.GetLocation node, it also retunrs sketch lines of sketch-based elements like floor slabs as well as the element's rotation property.
code_block_2 = CodeBlock { 500; }
extendStart = Curve.ExtendStart(curve=location.curves, distance=code_block_2)
extendEnd = Curve.ExtendEnd(curve=extendStart, distance=code_block_2)
code_block_3 = CodeBlock { 0; -200; }
byCoordinates = Vector.ByCoordinates(x=code_block_3.out0, y=code_block_3.out0, z=code_block_3.out1)
translate = Geometry.Translate(geometry=extendEnd, direction=byCoordinates)
element_types = ElementTypes("ViewFamilyType")
all_elements_of_type = ElementsOfType(element_type=element_types)
name = Element.Name(element=all_elements_of_type)
code_block_4 = CodeBlock { "Builderswork Section"; }
indexOf = List.IndexOf(list=name, element=code_block_4)
getItemAtIndex = List.GetItemAtIndex(list=all_elements_of_type, index=indexOf)
code_block_5 = CodeBlock { "Unconnected Height"; }
getParameterValueByName_2 = Element.GetParameterValueByName(element=byId, parameterName=code_block_5)
code_block_6 = CodeBlock(b=getParameterValueByName_2) { a=b+400; }
getType = WombatDynamo.Element.GetType(element=byId)
code_block_7 = CodeBlock { "Width"; }
getParameterValueByName_3 = Element.GetParameterValueByName(element=getType, parameterName=code_block_7)
code_block_8 = CodeBlock(d=getParameterValueByName_3) { c=d/2; }
byLine = Custom[ViewSection.ByLine](Curves=translate, ViewFamilyType=getItemAtIndex, ViewSectionHeight=code_block_6, OffsetFromLine=code_block_8, Depth=getParameterValueByName_3, lacing=Longest)  # package Data-Shapes; Create ViewSections in current document from DS Lines.
