# Dynamo graph Sort numbering sequence by model curve.dyn (Dynamo 2.5.0.7460)
# packages: Clockwork for Dynamo 2.x 2.3.0, spring nodes 204.1.0

select_categories_in_active_view = Categories("OST_LightingFixtures")  # graph input
all_elements_of_category = ElementsOfCategory(Category=select_categories_in_active_view)
all_elements_in_active_view = ElementsInView()
setIntersection = List.SetIntersection(list1=all_elements_of_category, list2=all_elements_in_active_view)
select_curve = DSModelElementSelection()  # nothing selected; graph input
geometry = Element.Geometry(element=select_curve)
XY = Plane.XY()
pullOntoPlane = Curve.PullOntoPlane(curve=geometry, plane=XY)
location = Custom[Element.Location+](element=setIntersection)  # package Clockwork for Dynamo 2.x; Returns the location of an element as point, curve or curve loop, along with some booleans to help filtering the results. Unlike the OOTB Element.GetLocation node, it also retunrs sketch lines of sketch-based elements like floor slabs as well as the element's rotation property.
code_block = CodeBlock { 0.5; }
pointAtParameter = Curve.PointAtParameter(curve=location.curves, param=code_block)
pullOntoPlane_2 = Custom[Springs.Point.PullOntoPlane](point=pointAtParameter, plane=XY)  # package spring nodes; Pulls (projects) the point onto the input plane, following the plane normal.
closestPointTo = Geometry.ClosestPointTo(geometry=pullOntoPlane, other=pullOntoPlane_2, lacing=Longest)
parameterAtPoint = Curve.ParameterAtPoint(curve=pullOntoPlane, point=closestPointTo, lacing=Longest)
sortByKey = List.SortByKey(list=setIntersection, keys=parameterAtPoint)
parameter_name = StringInput("")  # graph input
prefix_input_xxx_for_not = StringInput("xxx")  # "Prefix (input "xxx" for not required)"; graph input
code_block_2 = CodeBlock(a=prefix_input_xxx_for_not) { a=="xxx"; ""; }
if_ = If(test=code_block_2.out0, true=code_block_2.out1, false=prefix_input_xxx_for_not)
count = List.Count(list=sortByKey.sorted_list)
code_block_3 = CodeBlock(n=count) { 1..n..1; }
string_from_object = FromObject(obj=code_block_3)
number_of_digit = IntegerSlider(1, range=1..5 step 1)  # graph input
code_block_4 = CodeBlock { 5; '0'; }
padLeft = String.PadLeft(str=string_from_object, newWidth=number_of_digit, padChars=code_block_4.out1)
code_block_5 = CodeBlock(b=if_, c=padLeft) { b+c; }
setParameterByName = Element.SetParameterByName(element=sortByKey.sorted_list, parameterName=parameter_name, value=code_block_5)
parameterAtPoint_2 = Curve.ParameterAtPoint(curve=location.curves)  # unwired: point
